# Grasshopper definition 210701_compas_path_plan.gh (Grasshopper 1.0.7)

number_slider = Slider(9, range=0..44)
panel = Panel("fix 22")
crv = Curve([<curve referenced from the Rhino model> x45])
data = Data(crv)

# ---- group: profile
# 1.3125" (33.3mm) section.
# this dist is to corner
panel_2 = Panel("4")
panel_3 = Panel("0.0333375")
division = Division(A=panel_3, B="sqrt(2)")
polygon = Polygon(Plane=PlaneXY(0, 0, 0), Radius=division, Segments=panel_2, FilletRadius=0)  # -> Polygon, Length
rotate = Rotate(Geometry=polygon.Polygon, Angle=degrees("45"), Plane=PlaneXY(0, 0, 0))  # -> Geometry, Transform

# ----
pt = Point([<point referenced from the Rhino model> x16])
sph = Sphere(Base=pt, Radius="0.040")

panel_4 = Panel("approach planes offsets")
num = Number(Slider(0, range=0..1))
num_2 = Number(Slider(0.54, range=0..1))

num_3 = Number(number_slider)
dom = ConstructDomain(DomainStart="0", DomainEnd=num_3)
range = Range(Domain=dom, Steps=num_3)
item = ListItem(List=data, Index=range, Wrap=True)
panel_5 = Panel("0.040")
len = Length(Curve=item)
midpt = CurveMiddle(Curve=item)
pframes = PerpFrames(Curve=item, Count="1", Align=True)  # -> Frames, Parameters
panel_6 = Panel("0.020")
orient = Orient(Geometry=rotate.Geometry, Source=PlaneXY(0, 0, 0), Target=simplify(pframes.Frames))  # -> Geometry, Transform
python = GhPythonScript(radius=panel_5, offset=panel_6, len=len)  # -> z_factor; inputs len: list
# ---------- python: Python ----------
len_reduce = (radius + offset)*2

z_factor = [(l - len_reduce)/l for l in len]
# ---------- end python ----------
pl = PlaneNormal(Origin=midpt, ZAxis=item)
graft = GraftTree(Tree=item, IncludeEmptyLists=True, IncludeNullItems=True)
swp1 = Sweep1(Rail=graft, Sections=orient.Geometry, Miter=1)
scale_nu = ScaleNU(Geometry=simplify(swp1), Plane=simplify(graft(pl)), ScaleX=1, ScaleY=1, ScaleZ=simplify(graft(python)))  # -> Geometry, Transform

# ----
# close circle
# far circle
panel_7 = Panel(num)  # disabled
panel_8 = Panel(num_2)  # disabled
panel_9 = Panel("15")  # disabled
item_2 = ListItem(List=data, Index=number_slider, Wrap=True)  # disabled
midpt_2 = CurveMiddle(Curve=item_2)  # disabled
number_slider_2 = Slider(4, range=0..15)  # disabled
circle = CircleCNR(Center=midpt_2, Normal=item_2, Radius=panel_7)  # disabled
circle_2 = CircleCNR(Center=midpt_2, Normal=item_2, Radius=panel_8)  # disabled
divide = DivideCurve(Curve=circle, Count=panel_9, Kinks=False)  # -> Points, Tangents, Parameters; disabled
divide_2 = DivideCurve(Curve=circle_2, Count=panel_9, Kinks=False)  # -> Points, Tangents, Parameters; disabled
pl_2 = ConstructPlane(Origin=divide.Points, XAxis=item_2, YAxis=divide.Tangents)  # disabled
pl_3 = ConstructPlane(Origin=divide_2.Points, XAxis=item_2, YAxis=divide_2.Tangents)  # disabled
num_4 = Number(number_slider_2)  # disabled
num_5 = Number(number_slider_2)  # disabled
item_3 = ListItem(List=pl_2, Index=num_4, Wrap=True)  # disabled
item_4 = ListItem(List=pl_3, Index=num_5, Wrap=True)  # disabled

panel_10 = Panel(panel_3)
panel_11 = Panel(panel_3)
multiplication = Multiplication(A=len, B=python)
box = CenterBox(Base=PlaneXY(0, 0, 0), X=expr("x/2", multiplication), Y=expr("x/2", panel_10), Z=expr("x/2", panel_11))

item_5 = ListItem(List=pl, Index=number_slider, Wrap=True)  # disabled
item_6 = ListItem(List=flatten(scale_nu.Geometry), Index=number_slider, Wrap=True)  # disabled
deplane = DeconstructPlane(Plane=item_5)  # -> Origin, XAxis, YAxis, ZAxis; disabled
deplane_2 = DeconstructPlane(Plane=item_3)  # -> Origin, XAxis, YAxis, ZAxis; disabled
xprod = CrossProduct(VectorA=deplane.XAxis, VectorB=deplane_2.ZAxis, Unitize=True)  # -> Vector, Length; disabled
angle = Angle(VectorA=deplane_2.ZAxis, VectorB=deplane.XAxis)  # -> Angle, Reflex; disabled
dprod = DotProduct(VectorA=deplane.XAxis, VectorB=deplane_2.ZAxis, Unitize=True)  # disabled
dprod_2 = DotProduct(VectorA=xprod.Vector, VectorB=deplane.ZAxis, Unitize=False)  # disabled
python_2 = GhPythonScript(dot=dprod, cross_dot=dprod_2, a=angle.Angle)  # -> out, a; disabled
# ---------- python_2: Python ----------
if dot > 0 and cross_dot > 0:
    a = a
elif dot < 0 and cross_dot > 0:
    a = a
elif dot < 0 and cross_dot < 0:
    a = -a
elif dot > 0 and cross_dot < 0:
    a = -a
# ---------- end python_2 ----------
rot3d = Rotate3D(Geometry=item_6, Angle=python_2.a, Center=deplane.Origin, Axis=deplane.ZAxis)  # -> Geometry, Transform; disabled
rotation_angle = Panel(python_2.a)  # disabled
preview = CustomPreview(
    Geometry=rot3d.Geometry,
    Material={diffuse=RGB(221, 160, 221), emission=RGB(66, 48, 66), shine=0.5, specular=RGB(255, 255, 255), transparency=0})  # disabled

addition = Addition(A="0.040", B="0.020")
panel_12 = Panel(len)
multiplication_2 = Multiplication(A=addition, B=2)
subtraction = Subtraction(A=panel_12, B=multiplication_2)
panel_13 = Panel(subtraction)
multiplication_3 = Multiplication(A=panel_13, B=1000)
panel_14 = Panel(multiplication_3)

# ---- group: lacing wobj
pln = Plane()  # disabled
pln_2 = Plane()  # disabled
python_3 = GhPythonScript()  # -> out, t_a; disabled
# ---------- python_3: Python ----------
from compas.geometry import Frame
from compas.geometry import Point
from compas_ghpython import draw_frame
from compas.geometry import Transformation

from compas_rhino.geometry import RhinoPlane


wobj_A = Frame.from_quaternion([0.999987, 0.002274, -0.001300, 0.004463])
wobj_A.point = [2239.98, 1816.570, 150.477]

f_a = RhinoPlane.from_geometry(wobj_A).to_compas() 
print(f_a)

t_a = Transformation.from_frame(f_a)
print t_a
# ---------- end python_3 ----------
python_4 = GhPythonScript(p_send1=pln_2, p_send2=pln, t_a=python_3.t_a)  # -> out, f_send_trans1, f_send_trans2; inputs p_send1: Plane; disabled
# ---------- python_4: Python ----------
from compas.geometry import Frame
from compas.geometry import Point
from compas_ghpython import draw_frame
from compas.geometry import Transformation

from compas_rhino.geometry import RhinoPlane

f_send1 = RhinoPlane.from_geometry(p_send1).to_compas() 
f_send2 = RhinoPlane.from_geometry(p_send2).to_compas() 

p_trans1 = f_send1.transformed(t_a.inverse())
p_trans2 = f_send2.transformed(t_a.inverse())

f_send_trans1 = draw_frame(p_trans1)
f_send_trans2 = draw_frame(p_trans2)
# ---------- end python_4 ----------
pln_3 = Plane(python_4.f_send_trans1)  # disabled
pln_4 = Plane(python_4.f_send_trans2)  # disabled

# ----
panel_15 = Panel("22 is messed up")
panel_16 = Panel("""0
pi
pi/2
-0.20944
-1.884956
2.722714
-0.20944+pi
-1.884956
-1.466077+pi
0.20944
-1.884956
1.884956
1.047198
Pi
-0.20944
-1.884956
-2.722714
0.20944
2.722714
2.722714
-1.047198
Pi
-1.047198 + pi/2
2.303835
-1.466077
-2.722714
-Pi
-0.20944
-1.466077
-1.884956
Pi
-1.884956
2.303835
-1.884956
-0.20944
0.628319
0.628319
2.303835
1.466077
1.466077
1.884956
1.884956
-0.20944
-1.466077
-1.466077""")
item_7 = ListItem(List=panel_16, Index=range, Wrap=True)

mesh = Mesh(box)

panel_17 = Panel(number_slider)
rot3d_2 = Rotate3D(Geometry=simplify(graft(pl)), Angle=simplify(graft(item_7)), Center=simplify(graft(midpt)), Axis=simplify(graft(item)))  # -> Geometry, Transform
rot3d_3 = Rotate3D(
    Geometry=simplify(graft(scale_nu.Geometry)),
    Angle=simplify(graft(item_7)),
    Center=simplify(graft(midpt)),
    Axis=simplify(graft(item)))  # -> Geometry, Transform
item_8 = ListItem(List=flatten(rot3d_2.Geometry), Index=panel_17, Wrap=True)
item_9 = ListItem(List=flatten(rot3d_3.Geometry), Index=panel_17, Wrap=True)
item_10 = ListItem(List=flatten(mesh), Index=panel_17, Wrap=True)

panel_18 = Panel(num)
panel_19 = Panel(num_2)
deplane_3 = DeconstructPlane(Plane=item_8)  # -> Origin, XAxis, YAxis, ZAxis
multiplication_4 = Multiplication(A=deplane_3.XAxis, B=panel_18)
multiplication_5 = Multiplication(A=deplane_3.XAxis, B=panel_19)
move = Move(Geometry=deplane_3.Origin, Motion=expr("-x", multiplication_4))  # -> Geometry, Transform
move_2 = Move(Geometry=deplane_3.Origin, Motion=expr("-x", multiplication_5))  # -> Geometry, Transform
multiplication_6 = Multiplication(A=move.Geometry, B=1000)
multiplication_7 = Multiplication(A=move_2.Geometry, B=1000)
pl_4 = ConstructPlane(Origin=multiplication_6, XAxis=deplane_3.YAxis, YAxis=deplane_3.ZAxis)
pl_5 = ConstructPlane(Origin=move.Geometry, XAxis=deplane_3.YAxis, YAxis=deplane_3.ZAxis)
pl_6 = ConstructPlane(Origin=multiplication_7, XAxis=deplane_3.YAxis, YAxis=deplane_3.ZAxis)
pl_7 = ConstructPlane(Origin=move_2.Geometry, XAxis=deplane_3.YAxis, YAxis=deplane_3.ZAxis)

mesh_2 = Mesh(flatten(sph))
panel_20 = Panel("1500")
panel_21 = Panel("5000")
panel_22 = Panel("1000")

# ----
# R2 PICKUP PLANES
panel_23 = Panel("1836.5")
Z = UnitZ(Factor="0.450")
vec = VectorXYZ(XComponent="-0.5", YComponent="-0.5", ZComponent="0.450")  # -> Vector, Length
pt_2 = ConstructPoint(XCoordinate="3246.00", YCoordinate=panel_23, ZCoordinate="733.4")
X = UnitX(Factor=1)
Y = UnitY(Factor=1)
division_2 = Division(A=pt_2, B=1000)
multiplication_8 = Multiplication(A=Z, B=1000)
multiplication_9 = Multiplication(A=vec.Vector, B=1000)
pl_8 = ConstructPlane(Origin=division_2, XAxis=expr("-x", X), YAxis=Y)
pl_9 = ConstructPlane(Origin=pt_2, XAxis=expr("-x", X), YAxis=Y)
move_3 = Move(Geometry=pl_9, Motion=multiplication_9)  # -> Geometry, Transform
move_4 = Move(Geometry=pl_9, Motion=multiplication_8)  # -> Geometry, Transform
move_5 = Move(Geometry=pl_8, Motion=vec.Vector)  # -> Geometry, Transform
move_6 = Move(Geometry=pl_8, Motion=Z)  # -> Geometry, Transform
pln_5 = Plane(move_6.Geometry)
pln_6 = Plane(pl_8)
pln_7 = Plane(move_3.Geometry)
pln_8 = Plane(move_5.Geometry)
pln_9 = Plane(move_4.Geometry)
pln_10 = Plane(pl_9)

pln_11 = Plane(pln_8)

# ----
# R1 - PICKUP PLANES
panel_24 = Panel("0.450")
Z_2 = UnitZ(Factor=panel_24)
vec_2 = VectorXYZ(XComponent="-0.5", YComponent="0.5", ZComponent=panel_24)  # -> Vector, Length
pt_3 = ConstructPoint(XCoordinate="3246.00", YCoordinate="1838.30", ZCoordinate="729.6")
X_2 = UnitX(Factor=1)
Y_2 = UnitY(Factor=1)
division_3 = Division(A=pt_3, B=1000)
multiplication_10 = Multiplication(A=Z_2, B=1000)
multiplication_11 = Multiplication(A=vec_2.Vector, B=1000)
pl_10 = ConstructPlane(Origin=division_3, XAxis=expr("-x", X_2), YAxis=Y_2)
pl_11 = ConstructPlane(Origin=pt_3, XAxis=expr("-x", X_2), YAxis=Y_2)
move_7 = Move(Geometry=pl_10, Motion=vec_2.Vector)  # -> Geometry, Transform
move_8 = Move(Geometry=pl_11, Motion=multiplication_11)  # -> Geometry, Transform
move_9 = Move(Geometry=pl_10, Motion=Z_2)  # -> Geometry, Transform
move_10 = Move(Geometry=pl_11, Motion=multiplication_10)  # -> Geometry, Transform
pln_12 = Plane(move_9.Geometry)
pln_13 = Plane(pl_10)
pln_14 = Plane(move_7.Geometry)
pln_15 = Plane(move_10.Geometry)
pln_16 = Plane(pl_11)
pln_17 = Plane(move_8.Geometry)

pln_18 = Plane(pln_14)

# ----
# VIZUALIZE
mesh_3 = Mesh(flatten(item_9))
pln_19 = Plane(pl_5)
pln_20 = Plane(pl_7)
pln_21 = Plane(pln_5)
mesh_4 = Mesh(flatten(rot3d_3.Geometry))
pln_22 = Plane(pln_12)
pln_23 = Plane(pln_13)
pln_24 = Plane(pln_6)
merge = Merge(Data1=pln_19, Data2=pln_20)
merge_2 = Merge(Data1=pln_22, Data2=pln_23, Data3=pln_21, Data4=pln_24, Data5=pln_18, Data6=pln_11)
shift = ShiftList(List=mesh_4, Shift=-1, Wrap=False)
preview_2 = CustomPreview(Geometry=mesh_2, Material=ColourSwatch(SwatchColor=RGB(112, 129, 255)))
preview_3 = CustomPreview(Geometry=mesh_3, Material=ColourSwatch(SwatchColor=RGB(4, 0, 255)))
preview_4 = CustomPreview(Geometry=shift, Material=ColourSwatch(SwatchColor=RGB(124, 125, 59)))
preview_5 = CustomPreview(
    Geometry=merge_2,
    Material={diffuse=RGB(0, 238, 255), emission=RGB(0, 71, 76), shine=0.5, specular=RGB(255, 255, 255), transparency=0})
preview_6 = CustomPreview(Geometry=merge, Material=ColourSwatch(SwatchColor=RGB(4, 0, 255)))

list = ValueList({"Robot 1": 1, "Robot 2": 2}, selected="Robot 2")
panel_25 = Panel(list)

python_5 = GhPythonScript()  # -> t_a
# ---------- python_5: Python ----------
from compas.geometry import Frame
from compas.geometry import Point
from compas_ghpython import draw_frame
from compas.geometry import Transformation

from compas_rhino.geometry import RhinoPlane

wobj_A = Frame.from_quaternion([0.999964,0.00426176,-0.00158504,-0.00717332])
wobj_A.point = [-681.039,1564.71,817.284]

f_a = RhinoPlane.from_geometry(wobj_A).to_compas() 
print(f_a)

t_a = Transformation.from_frame(f_a)
print t_a
# ---------- end python_5 ----------

pln_25 = Plane(pln_15)
pln_26 = Plane(pln_16)
pln_27 = Plane(pln_17)
merge_3 = Merge(Data1=pln_25, Data2=pln_26, Data3=pln_27)
python_6 = GhPythonScript(p_send=merge_3, t_a=python_5)  # -> f_send; inputs p_send: list
# ---------- python_6: Python ----------
from compas.geometry import Frame
from compas_ghpython import draw_frame
from compas_rhino.geometry import RhinoPlane
#
f_send = []
for p in p_send:
    f = RhinoPlane.from_geometry(p).to_compas()
    f_trans = f.transformed(t_a.inverse())
    f_send.append(f_trans)
    
print f_send
# ---------- end python_6 ----------

pln_28 = Plane(pl_6)
pln_29 = Plane(pl_4)
merge_4 = Merge(Data1=pln_28, Data2=pln_29)
python_7 = GhPythonScript(p_send=merge_4, t_a=python_5)  # -> f_send; inputs p_send: list
# ---------- python_7: Python ----------
from compas.geometry import Frame
from compas_ghpython import draw_frame
from compas_rhino.geometry import RhinoPlane

f_send = []
for p in p_send:
    f = RhinoPlane.from_geometry(p).to_compas()
    f_trans = f.transformed(t_a.inverse())
    f_send.append(f_trans)
    
print f_send
# ---------- end python_7 ----------

pln_30 = Plane(pln_9)
pln_31 = Plane(pln_10)
pln_32 = Plane(pln_7)
merge_5 = Merge(Data1=pln_30, Data2=pln_31, Data3=pln_32)
python_8 = GhPythonScript(p_send=merge_5, t_a=python_5)  # -> f_send; inputs p_send: list; same code as python_6

# ----
# Robot 1
j1 = Slider(-81.69, range=-180..180)
j2 = Slider(0, range=-90..150)
j3 = Slider(0, range=-180..75)
j4 = Slider(0, range=-400..400)
j5 = Slider(97.15, range=-125..120)
j6 = Slider(183.05, range=-400..400)
track = Slider(0, range=0..4)
data_2 = Data([j1, j2, j3, j4, j5, j6, track])

# ----
# Robot 1
python_9 = GhPythonScript()  # -> out, config
# ---------- python_9: Python ----------
#axis 1-6 + track (mm)
#axis 1-6 + track
config = [
-90.0,
0.0,
0.0,
0.0,
90,
180,
100]
# ---------- end python_9 ----------
python_10 = GhPythonScript()  # -> out, config
# ---------- python_10: Python ----------
#axis 1-6 + track (mm)
config = [
-37.57,
-3.2400000000000002,
8.3599999999999994,
0.19,
84.450000000000003,
-127.56,
100]

#(RobotJoints([-37.57, -3.2400000000000002, 8.3599999999999994, 0.19, 84.450000000000003, -127.56]), ExternalAxes([100.0]))
# ---------- end python_10 ----------

# ----
# Robot 2
python_11 = GhPythonScript()  # -> out, config
# ---------- python_11: Python ----------
#axis 1-6 + track
config = [
40.549999999999997,
16.210000000000001,
-13.890000000000001,
-0.0,
87.680000000000007,
130.55000000000001,
3888.1100000000001]
# ---------- end python_11 ----------
python_12 = GhPythonScript()  # -> out, config
# ---------- python_12: Python ----------
#axis 1-6 + track
config = [
90.0,
0.0,
0.0,
0.0,
90,
180,
3888.1100000000001]
# ---------- end python_12 ----------

# ----
# Robot 2
j1_2 = Slider(92.58, range=-180..180)
j2_2 = Slider(0, range=-90..150)
j3_2 = Slider(0, range=-180..75)
j4_2 = Slider(0, range=-400..400)
j5_2 = Slider(90, range=-125..120)
j6_2 = Slider(190.17, range=-400..400)
track_2 = Slider(4, range=0..4)
data_3 = Data([j1_2, j2_2, j3_2, j4_2, j5_2, j6_2, track_2])

data_4 = Data(["Grasshopper.Kernel.Types.GH_ObjectWrapper", "Grasshopper.Kernel.Types.GH_ObjectWrapper"])  # disabled
panel_26 = Panel(list)
list_2 = ValueList({"Forward Kinematics": 0, "Inverse Kinematics": 1, "Preset Start Point": 2}, selected="Preset Start Point")

panel_27 = Panel("approach")
panel_28 = Panel("place")
pln_33 = Plane(pl_7)
pln_34 = Plane(pl_5)

panel_29 = Panel("C:/Users/Edvard/Documents/GitHub/workshop_princeton_2021/ACADIA/output/")
panel_30 = Panel(number_slider)
python_13 = GhPythonScript(path=panel_29, member_num=panel_30, read_data=Toggle(True))  # -> configs
# ---------- python_13: Python ----------
import os
from compas_fab.utilities import read_data_from_json
from compas_fab.robots import Configuration

if read_data:
    data = read_data_from_json(os.path.join(path, 'member_{}.json'.format(member_num)))

    print data['config_1']
    print len(data)

configs = []
for i in range(len(data)):
    configs.append(Configuration.from_data(data['config_{}'.format(i)]))
    
print configs[1]
# ---------- end python_13 ----------
python_14 = GhPythonScript(configs=python_13)  # -> out, r1_place, r2_place; inputs configs: list
# ---------- python_14: Python ----------
import math
import compas_rrc as rrc

#configs = configs
    
r1_place = []
r2_place = []
for c in configs:
    r1_axes = rrc.ExternalAxes(c['r1_cart_joint']*1000)
    r1_joints = rrc.RobotJoints(
        math.degrees(c['r1_joint_1']),
        math.degrees(c['r1_joint_2']),
        math.degrees(c['r1_joint_3']),
        math.degrees(c['r1_joint_4']),
        math.degrees(c['r1_joint_5']),
        math.degrees(c['r1_joint_6']),
    )
    
    r2_axes = rrc.ExternalAxes(c['r2_cart_joint']*1000)
    r2_joints = rrc.RobotJoints(
        math.degrees(c['r2_joint_1']),
        math.degrees(c['r2_joint_2']),
        math.degrees(c['r2_joint_3']),
        math.degrees(c['r2_joint_4']),
        math.degrees(c['r2_joint_5']),
        math.degrees(c['r2_joint_6']),
    )
    
    r1_place.append([r1_axes, r1_joints])
    r2_place.append([r2_axes, r2_joints])
# ---------- end python_14 ----------
data_5 = Data(python_14.r1_place)
data_6 = Data(python_14.r2_place)
panel_31 = Panel(python_13)

# ----
# If axis is included then allow the robot to move along track
toggle = BooleanToggle(True)
ros = ROSConnect(connect=Toggle(True))  # -> ros_client, is_connected; inputs port: Int32, connect: Boolean
#   port ip: The ip address ROS. Defaults to 127.0.0.1.
#   port port: The port of ROS. Defaults to 9090.
#   port connect: If True, connects to ROS. If False, disconnects from ROS. Defaults to False.
#   port ros_client: The ROS client.
#   port is_connected: True if connection established.
# ---------- ros: Python ----------
"""
Connect or disconnect to ROS.

COMPAS FAB v0.19.1
"""
from ghpythonlib.componentbase import executingcomponent as component
from scriptcontext import sticky as st

from compas_fab.backends import RosClient
from compas_fab.ghpython.components import create_id


class ROSConnect(component):
    def RunScript(self, ip, port, connect):
        ros_client = None

        ip = ip or '127.0.0.1'
        port = port or 9090

        key = create_id(self, 'ros_client')
        ros_client = st.get(key, None)

        if ros_client:
            st[key].close()
        if connect:
            st[key] = RosClient(ip, port)
            st[key].run(5)

        ros_client = st.get(key, None)
        is_connected = ros_client.is_connected if ros_client else False
        return (ros_client, is_connected)
# ---------- end ros ----------
data_7 = Data(ros.ros_client)
robot = ROSRobot(ros_client=data_7, load=toggle)  # -> robot; inputs load: Boolean
#   port ros_client: The ROS client.
#   port load: If True, loads the robot from ROS. Defaults to False.
# ---------- robot: Python ----------
"""
Load robot directly from ROS.

COMPAS FAB v0.19.1
"""
from compas_ghpython.artists import RobotModelArtist
from ghpythonlib.componentbase import executingcomponent as component
from scriptcontext import sticky as st

from compas_fab.ghpython.components import create_id


class ROSRobot(component):
    def RunScript(self, ros_client, load):
        key = create_id(self, 'robot')

        if ros_client and ros_client.is_connected and load:
            # Load URDF from ROS
            st[key] = ros_client.load_robot(load_geometry=True, precision='12f')
            st[key].artist = RobotModelArtist(st[key].model)

        robot = st.get(key, None)
        if robot:  # client sometimes need to be restarted, without needing to reload geometry
            robot.client = ros_client
        return robot
# ---------- end robot ----------
list_3 = ValueList({"Robot 1": "robot1", "Robot 2": "robot2", "Robot 1 axis": "robot1_axis", "Robot 2 axis": "robot2_axis", "Robot 1 axis gripper": "robot1_axis_gripper", "Robot 2 axis gripper": "robot2_axis_gripper"}, selected="Robot 1 axis gripper")
list_4 = ValueList({"Robot 1": "robot1", "Robot 2": "robot2", "Robot 1 axis": "robot1_axis", "Robot 2 axis": "robot2_axis", "Robot 1 axis gripper": "robot1_axis_gripper", "Robot 2 axis gripper": "robot2_axis_gripper"}, selected="Robot 2 axis gripper")
list_5 = ValueList({"platform": "ecl_platform", "world": "ecl_zero", "wobj_1": "rob1_acadia_EBIT_01", "wobj_2": "rob2_acadia_EBIT_01"}, selected="wobj_2")
list_6 = ValueList({"platform": "ecl_platform", "world": "ecl_zero", "wobj_1": "rob1_acadia_EBIT_01", "wobj_2": "rob2_acadia_EBIT_01"}, selected="wobj_1")
data_8 = Data(list_3)
data_9 = Data(list_4)
panel_32 = Panel(list)
filter = StreamFilter(Gate=panel_32, Stream1=list_6, Stream2=list_5)
data_10 = Data(robot)

python_15 = GhPythonScript(robot=data_10, reset=Button())  # -> out, a
# ---------- python_15: Python ----------
print robot.info()

print robot.get_configurable_joint_names()
print robot.zero_configuration()
# ---------- end python_15 ----------
panel_33 = Panel(python_15.out)
filter_2 = StreamFilter(Gate=panel_25, Stream1=data_8, Stream2=data_9)
data_11 = Data(filter)

data_12 = Data(filter_2)

# ----
# IK
panel_34 = Panel(list)
pln_35 = Plane(pln_12)
pln_36 = Plane(pln_8)
filter_3 = StreamFilter(Gate=panel_34, Stream1=pln_35, Stream2=pln_36)
use_fk_as_start = BooleanToggle(False)
filter_4 = StreamFilter(Gate=use_fk_as_start)
ik = InverseKinematics(robot=data_10, plane=filter_3, start_configuration=filter_4, group=data_12)  # -> configuration
#   port plane: The plane or frame to calculate the inverse kinematic for.
#   port start_configuration: If passed, calculates the inverse such that the joint positions differ the least from the start_configuration. Defaults to the zero configuration.
#   port group: The planning group used for calculation. Defaults to the robot's main planning group.
#   port configuration: The planning group's configuration.
# ---------- ik: Python ----------
"""
Calculate the robot's inverse kinematic for a given plane.

COMPAS FAB v0.19.1
"""
from ghpythonlib.componentbase import executingcomponent as component

from compas_fab.ghpython.components import coerce_frame


class InverseKinematics(component):
    def RunScript(self, robot, plane, start_configuration, group):
        configuration = None
        if robot and robot.client and robot.client.is_connected and plane:
            frame = coerce_frame(plane)
            configuration = robot.inverse_kinematics(frame, start_configuration, group)
        if start_configuration:
            return start_configuration.merged(configuration)
        else:
            return configuration
# ---------- end ik ----------

# ----
# R1 (Left)
# this track value is changed if "axis" group is used, otherwise it is fixed
number_slider_3 = Slider(0, range=0..3.9)  # disabled
python_16 = GhPythonScript(robot=data_10, group=data_8, base_position=number_slider_3)  # -> out, config; disabled
# ---------- python_16: Python ----------
config = robot.zero_configuration()

print group[5]

#only do this if track not being used (fixed base)
if group in ("robotA", "robotB"):
    print "not using track"
    base_joint_name = group[5] + '_cart_joint'
    config[base_joint_name] = base_position
    print config

else:
    print "using track"
    config = None
# ---------- end python_16 ----------
ik_2 = InverseKinematics(robot=data_10, plane=pln_35, start_configuration=python_16.config, group=data_8)  # -> configuration; disabled
#   port plane: The plane or frame to calculate the inverse kinematic for.
#   port start_configuration: If passed, calculates the inverse such that the joint positions differ the least from the start_configuration. Defaults to the zero configuration.
#   port group: The planning group used for calculation. Defaults to the robot's main planning group.
#   port configuration: The planning group's configuration.
# ---------- ik_2: Python ----------
"""
Calculate the robot's inverse kinematic for a given plane.

COMPAS FAB v0.19.1
"""
from ghpythonlib.componentbase import executingcomponent as component

from compas_fab.ghpython.components import coerce_frame


class InverseKinematics(component):
    def RunScript(self, robot, plane, start_configuration, group):
        configuration = None
        if robot and robot.client and robot.client.is_connected and plane:
            frame = coerce_frame(plane)
            configuration = robot.inverse_kinematics(frame, start_configuration, group)
        return configuration
# ---------- end ik_2 ----------
python_17 = GhPythonScript(robot=data_10, group=data_8, start_config=python_16.config, group_config=ik_2)  # -> out, config; disabled
# ---------- python_17: Python ----------
#zero_config = robot.zero_configuration()
#print zero_config
#
#print group_config
#print start_config


config = robot.merge_group_with_full_configuration(group_config, start_config, group)
config['r1_cart_joint'] = 3900 - 34.14
config['r1_joint_1'] = -0.253422
config['r1_joint_2'] = 0.185179
config['r1_joint_3'] = -0.072431
config['r1_joint_4'] = 0.000175
config['r1_joint_5'] = 1.449845
config['r1_joint_6'] = -1.823869

print config
# ---------- end python_17 ----------

# ----
# R2 (Right)
# this track value is changed if "axis" group is used, otherwise it is fixed
number_slider_4 = Slider(3.9, range=0..3.9)  # disabled
python_18 = GhPythonScript(robot=data_10, group=data_9, base_position=number_slider_4)  # -> out, config; disabled; same code as python_16
ik_3 = InverseKinematics(robot=data_10, plane=pln_36, start_configuration=python_18.config, group=data_9)  # -> configuration; disabled; same code as ik_2
python_19 = GhPythonScript(robot=data_10, group=data_9, start_config=python_18.config, group_config=ik_3)  # -> out, config; disabled
# ---------- python_19: Python ----------
config = robot.merge_group_with_full_configuration(group_config, start_config, group)

zero_config = robot.zero_configuration()
print zero_config

print start_config
print group_config

print(config)
# ---------- end python_19 ----------

# ----
# FK
config = GhPythonScript(robot=data_10, r1=data_2, r2=data_3)  # -> config; inputs r1: list, r2: list
# ---------- config: Python ----------
import math

config = robot.zero_configuration()

for i in range(6):
    config['r1_joint_{}'.format(i + 1)] = math.radians(r1[i])
    config['r2_joint_{}'.format(i + 1)] = math.radians(r2[i])

config['r1_cart_joint'] = r1[6]
config['r2_cart_joint'] = r2[6]

print config
# ---------- end config ----------
gripper_frames = GhPythonScript(robot=data_10, config=config)  # -> out
# ---------- gripper_frames: Python ----------
print repr(robot.forward_kinematics(config, group='robot1_axis_gripper'))
print repr(robot.forward_kinematics(config, group='robot2_axis_gripper'))
# ---------- end gripper_frames ----------
panel_35 = Panel(gripper_frames)

# ----
# FK - Preset Values
config_2 = GhPythonScript(robot=data_10, r1=python_10.config, r2=python_11.config)  # -> config; inputs r1: list, r2: list
# ---------- config_2: Python ----------
import math

config = robot.zero_configuration()

for i in range(6):
    config['r1_joint_{}'.format(i + 1)] = math.radians(r1[i])
    config['r2_joint_{}'.format(i + 1)] = math.radians(r2[i])

#mm --> m
config['r1_cart_joint'] = r1[6]/1000
config['r2_cart_joint'] = r2[6]/1000

print config
# ---------- end config_2 ----------
config_3 = GhPythonScript(robot=data_10, r1=python_9.config, r2=python_12.config)  # -> config; inputs r1: list, r2: list
# ---------- config_3: Python ----------
import math

config = robot.zero_configuration()

for i in range(6):
    config['r1_joint_{}'.format(i + 1)] = r1[i]
    config['r2_joint_{}'.format(i + 1)] = r2[i]

#mm
config['r1_cart_joint'] = r1[6]
config['r2_cart_joint'] = r2[6]

print config
# ---------- end config_3 ----------

panel_36 = Panel(data_11)
data_13 = Data(config_3)

data_14 = Data(data_7)
data_15 = Data(python_6)
data_16 = Data(python_8)
data_17 = Data(python_7)
data_18 = Data(data_5)
data_19 = Data(data_6)
python_20 = GhPythonScript(
    ros=data_14,
    rob_num=panel_26,
    wobj=panel_36,
    return_config=data_13,
    send_return=Button(),
    pick_r1=data_15,
    pick_r2=data_16,
    send_pick=Button(),
    place=data_17,
    r1_place=data_18,
    r2_place=data_19,
    send_place_path=Button(),
    send_place=Button(),
    get_info=Toggle(False))  # -> out, current_joints; inputs rob_num: Int32, pick_r1: list, pick_r2: list, place: list, r1_place: list, r2_place: list
# ---------- python_20: Python ----------
import compas_rrc as rrc
from compas.geometry import Frame
from compas.geometry import Plane

from compas_rhino.geometry import RhinoPlane

# Create ABB Client (rob2 = right, rob1 = left)
if rob_num == 1:
    abb = rrc.AbbClient(ros, '/rob1')
    abb.send(rrc.SetTool('ecl_pneumatic_gripper'))
    DO = 'do_1'
    pick = pick_r1
    pick_track = 100
    path_place = r1_place
    print('Connected.')
elif rob_num == 2:
    abb = rrc.AbbClient(ros, '/rob2')
    abb.send(rrc.SetTool('ecl_pneumatic_gripper'))
    DO = 'do_2'
    pick = pick_r2
    pick_track = 3888.11
    path_place = r2_place
    print('Connected.')

# Define speeds
speed = 100

# set wobj
abb.send(rrc.SetWorkObject(wobj))

if get_info:
    current_joints = abb.send_and_wait(rrc.GetJoints(),  timeout = 3)
    print current_joints
    

if send_return:
    
    if rob_num == 1:
        axis = rrc.ExternalAxes(return_config['r1_cart_joint'])
        joints = rrc.RobotJoints(
            return_config['r1_joint_1'],
            return_config['r1_joint_2'],
            return_config['r1_joint_3'],
            return_config['r1_joint_4'],
            return_config['r1_joint_5'],
            return_config['r1_joint_6'],
        )
    elif rob_num == 2:
        axis = rrc.ExternalAxes(return_config['r2_cart_joint'])
        joints = rrc.RobotJoints(
            return_config['r2_joint_1'],
            return_config['r2_joint_2'],
            return_config['r2_joint_3'],
            return_config['r2_joint_4'],
            return_config['r2_joint_5'],
            return_config['r2_joint_6'],
        )
        
    
    done = abb.send(rrc.MoveToJoints(joints, axis, speed, rrc.Zone.FINE))
    print('Finished')


if send_pick:
    #open gripper
    done = abb.send_and_wait(rrc.SetDigital(DO,0), timeout = 10)
    
    done = abb.send_and_wait(rrc.MoveToFrame(pick[0], speed, rrc.Zone.FINE), timeout = 30)
    future = abb.send(rrc.Stop(feedback_level=rrc.FeedbackLevel.DONE))
    
    done = abb.send_and_wait(rrc.MoveToFrame(pick[1], speed, rrc.Zone.FINE), timeout = 30)
    future = abb.send(rrc.Stop(feedback_level=rrc.FeedbackLevel.DONE))
        
    #close gripper
    done = abb.send_and_wait(rrc.SetDigital(DO,1), timeout = 10)
    
    #back to start frame
    done = abb.send_and_wait(rrc.MoveToFrame(pick[0], speed, rrc.Zone.FINE), timeout = 10)
    future = abb.send(rrc.Stop(feedback_level=rrc.FeedbackLevel.DONE))
    
    ext_axes = rrc.ExternalAxes(pick_track)
    done = abb.send_and_wait(rrc.MoveToRobtarget(pick[2],ext_axes,speed, rrc.Zone.FINE), timeout = 30)
    future = abb.send(rrc.Stop(feedback_level=rrc.FeedbackLevel.DONE))
    
    print('Finished')
    
    
if send_place:
    
    for f in place:
        done = abb.send_and_wait(rrc.MoveToFrame(f, speed, rrc.Zone.FINE), timeout = 30)
        future = abb.send(rrc.Stop(feedback_level=rrc.FeedbackLevel.DONE))
        
    print('Finished')
    
    
if send_place_path:
    
    # execute planned path
    # formatted as RobotJoints and ExternalAxes object 
    for axis,joints in path_place:
        print axis, joints
        done = abb.send(rrc.MoveToJoints(joints, axis, speed, rrc.Zone.FINE))
        #future = abb.send(rrc.Stop(feedback_level=rrc.FeedbackLevel.DONE)) 

    print('Finished')
# ---------- end python_20 ----------

python_21 = GhPythonScript(robot=data_10, group=data_8, start_config=python_16.config, group_config=ik_2)  # -> out, config; disabled
# ---------- python_21: Python ----------
#zero_config = robot.zero_configuration()
#print zero_config
#
#print group_config
#print start_config


config = robot.merge_group_with_full_configuration(group_config, start_config, group)
print(config)
# ---------- end python_21 ----------
python_22 = GhPythonScript(robot=data_10, group=data_9, start_config=python_18.config, group_config=ik_3, x=data_4)  # -> out, config; inputs x: list; disabled
# ---------- python_22: Python ----------
#config = robot.merge_group_with_full_configuration(group_config, start_config, group)

import math

config = robot.zero_configuration()

rob_joints = x[0]
ext_axes = x[1]

j_rad = [math.radians(j) for j in rob_joints]
print ext_axes

config['r2_cart_joint'] = ext_axes[0]/1000
config['r2_joint_1'] = j_rad[0]
config['r2_joint_2'] = j_rad[1]
config['r2_joint_3'] = j_rad[2]
config['r2_joint_4'] = j_rad[3]
config['r2_joint_5'] = j_rad[4]
config['r2_joint_6'] = j_rad[5]

print config
# ---------- end python_22 ----------
python_23 = GhPythonScript(robot=data_10, config1=python_21.config, config2=python_19.config)  # -> out, merged_config; disabled
# ---------- python_23: Python ----------
merged_config = robot.zero_configuration().merged(config2)

#manually enter in Rob B joints in full config
merged_config['r1_cart_joint'] = config1['r1_cart_joint']
merged_config['r1_joint_1'] = config1['r1_joint_1']
merged_config['r1_joint_2'] = config1['r1_joint_2']
merged_config['r1_joint_3'] = config1['r1_joint_3']
merged_config['r1_joint_4'] = config1['r1_joint_4']
merged_config['r1_joint_5'] = config1['r1_joint_5']
merged_config['r1_joint_6'] = config1['r1_joint_6']

print merged_config
print config2['r2_cart_joint']
print config1['r1_cart_joint']
# ---------- end python_23 ----------
python_24 = GhPythonScript(robot=data_10, config1=python_17.config, config2=python_19.config)  # -> out, merged_config; disabled
# ---------- python_24: Python ----------
merged_config = robot.zero_configuration().merged(config2)

#manually enter in Rob B joints in full config
merged_config['r1_cart_joint'] = 3900
merged_config['r1_joint_1'] = config1['r1_joint_1']
merged_config['r1_joint_2'] = config1['r1_joint_2']
merged_config['r1_joint_3'] = config1['r1_joint_3']
merged_config['r1_joint_4'] = config1['r1_joint_4']
merged_config['r1_joint_5'] = config1['r1_joint_5']
merged_config['r1_joint_6'] = config1['r1_joint_6']

merged_config['r2_cart_joint'] = 3900
merged_config['r2_joint_1'] = config1['r1_joint_1']
merged_config['r2_joint_2'] = config1['r1_joint_2']
merged_config['r2_joint_3'] = config1['r1_joint_3']
merged_config['r2_joint_4'] = config1['r1_joint_4']
merged_config['r2_joint_5'] = config1['r1_joint_5']
merged_config['r2_joint_6'] = config1['r1_joint_6']

print merged_config
print config2['r2_cart_joint']
print config1['r1_cart_joint']
# ---------- end python_24 ----------
filter_5 = StreamFilter(Gate=list_2, Stream0=config, Stream1=ik, Stream2=config_2)
robot_visualize = RobotVisualize(robot=data_10, configuration=filter_5)  # -> visual, collision, attached_meshes, frames, base_frame, ee_frame; inputs attached_collision_meshes: list, show_visual: Boolean, show_collision: Boolean, show_frames: Boolean, show_base_frame: Boolean, show_end_effector_frame: Boolean, show_acm: Boolean
#   port group: The planning group used for end-effector and base visualization.
#   port configuration: The robot's full configuration.
#   port attached_collision_meshes: A list of attached collision meshes.
#   port show_visual: Whether or not to show the robot's visual meshes.
#   port show_collision: Whether or not to show the robot's collision meshes.
#   port show_frames: Whether or not to show the robot's joint frames.
#   port show_base_frame: Whether or not to show the robot's base frame.
#   port show_end_effector_frame: Whether or not to show the robot's end-effector frame.
#   port show_acm: Whether or not to show the attached collision meshes (if any).
#   port visual: The robot's visual Rhino meshes (if any).
#   port collision: The robot's collision Rhino meshes (if any).
#   port attached_meshes: The attached collision Rhino meshes (if any).
#   port frames: The robot's joint frames as Rhino planes (if any).
#   port base_frame: The robot's base frame as a Rhino plane (if any).
#   port ee_frame: The robot's end-effector frame as a Rhino plane (if any).
# ---------- robot_visualize: Python ----------
"""
Visualizes the robot.

COMPAS FAB v0.19.1
"""
from compas.geometry import Frame
from compas.geometry import Transformation
from compas_ghpython.artists import FrameArtist
from compas_ghpython.artists import MeshArtist
from ghpythonlib.componentbase import executingcomponent as component


class RobotVisualize(component):
    def RunScript(self, robot, group, configuration, attached_collision_meshes, show_visual, show_collision,
                  show_frames, show_base_frame, show_end_effector_frame, show_acm):

        visual = None
        collision = None
        attached_meshes = None
        frames = None
        base_frame = None
        ee_frame = None

        if robot:
            show_visual = True if show_visual is None else show_visual
            configuration = configuration or robot.zero_configuration()

            robot.update(configuration, visual=show_visual, collision=show_collision)
            compas_frames = robot.transformed_frames(configuration, group)

            if show_visual:
                visual = robot.artist.draw_visual()

            if show_collision:
                collision = robot.artist.draw_collision()

            if show_base_frame:
                base_compas_frame = compas_frames[0]
                artist = FrameArtist(base_compas_frame)
                base_frame = artist.draw()

            if show_end_effector_frame:
                ee_compas_frame = robot.forward_kinematics(configuration, group, options=dict(solver='model'))
                artist = FrameArtist(ee_compas_frame)
                ee_frame = artist.draw()

            if show_frames:
                frames = []
                for compas_frame in compas_frames[1:]:
                    artist = FrameArtist(compas_frame)
                    frame = artist.draw()
                    frames.append(frame)

            if show_acm:
                attached_meshes = []
                for acm in attached_collision_meshes:
                    frame = robot.forward_kinematics(configuration, options=dict(solver='model', link_name=acm.link_name))
                    T = Transformation.from_frame_to_frame(Frame.worldXY(), frame)
                    mesh = acm.collision_mesh.mesh.transformed(T)
                    attached_meshes.append(MeshArtist(mesh).draw())

        return (visual, collision, attached_meshes, frames, base_frame, ee_frame)
# ---------- end robot_visualize ----------
panel_37 = Panel(python_20.out)
panel_38 = Panel(python_20.current_joints)

scene = PlanningScene(robot=data_10)  # -> scene
#   port scene: A planning scene.
# ---------- scene: Python ----------
"""
Create a planning scene.

COMPAS FAB v0.19.1
"""
from ghpythonlib.componentbase import executingcomponent as component
from scriptcontext import sticky as st

from compas_fab.ghpython.components import create_id
from compas_fab.robots import PlanningScene


class PlanningSceneComponent(component):
    def RunScript(self, robot):
        key = create_id(self, 'planning_scene')
        if robot:
            st[key] = PlanningScene(robot)
        return st.get(key, None)
# ---------- end scene ----------
mesh_5 = Mesh(item_10)
mesh_6 = Mesh(flatten(rot3d_3.Geometry))
mesh_7 = Mesh(item_10)
shift_2 = ShiftList(List=flatten(mesh_6), Shift=-1, Wrap=False)
mjoin = MeshJoin(Meshes=shift_2)
mesh_8 = Mesh(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)
acm = AttachedCollisionMesh(
    scene=scene,
    mesh=mesh_5,
    identifier="member",
    link_name="r1_tcp",
    touch_links="r1_gripper",
    add=Button(),
    remove=Button())  # -> attached_collision_mesh; inputs mesh: Mesh, touch_links: list, add: Boolean, remove: Boolean
#   port scene: The planning scene.
#   port mesh: A collision mesh.
#   port identifier: The identifier of the collision mesh.
#   port link_name: The robot's link name to attach the mesh to.
#   port touch_links: Names of links that the robot is allowed to touch.
#   port add: If True, adds the collision mesh to the planning scene.
#   port remove: If True, removes the collision mesh from the planning scene.
#   port attached_collision_mesh: A collision mesh that is attached to a robot's link.
# ---------- acm: Python ----------
"""
Add an attached collision mesh to the robot.

COMPAS FAB v0.19.1
"""
from ghpythonlib.componentbase import executingcomponent as component

from compas_rhino.geometry import RhinoMesh
from compas_fab.robots import AttachedCollisionMesh
from compas_fab.robots import CollisionMesh


class AttachedCollisionMeshComponent(component):
    def RunScript(self, scene, mesh, identifier, link_name, touch_links, add, remove):
        attached_collision_mesh = None
        if scene and mesh and identifier and link_name:
            compas_mesh = RhinoMesh.from_geometry(mesh).to_compas()
            collision_mesh = CollisionMesh(compas_mesh, identifier)
            attached_collision_mesh = AttachedCollisionMesh(collision_mesh, link_name, touch_links)
            if add:
                scene.add_attached_collision_mesh(attached_collision_mesh)
            if remove:
                scene.remove_attached_collision_mesh(identifier)
                scene.remove_collision_mesh(identifier)
        return attached_collision_mesh
# ---------- end acm ----------
acm_2 = AttachedCollisionMesh(
    scene=scene,
    mesh=mesh_7,
    identifier="member",
    link_name="r2_tcp",
    touch_links="r2_gripper",
    add=Button(),
    remove=Button())  # -> attached_collision_mesh; inputs mesh: Mesh, touch_links: list, add: Boolean, remove: Boolean; same code as acm
cm = CollisionMesh(scene=scene, mesh=simplify(mjoin), identifier="structure_mesh", add=Button(), remove=Button())  # -> ok; inputs mesh: Mesh, add: Boolean, remove: Boolean
#   port scene: The planning scene.
#   port mesh: A collision mesh.
#   port identifier: The identifier of the collision mesh.
#   port add: If True, adds the collision mesh to the planning scene.
#   port remove: If True, removes the collision mesh from the planning scene.
#   port ok: True if the operation was successfully performed.
# ---------- cm: Python ----------
"""
Add or remove a collision mesh from the planning scene.

COMPAS FAB v0.19.1
"""
from compas_rhino.geometry import RhinoMesh
from ghpythonlib.componentbase import executingcomponent as component

from compas_fab.robots import CollisionMesh


class CollisionMeshComponent(component):
    def RunScript(self, scene, M, name, add, remove):
        ok = False
        if scene and M and name:
            mesh = RhinoMesh.from_geometry(M).to_compas()
            collision_mesh = CollisionMesh(mesh, name)
            if add:
                scene.add_collision_mesh(collision_mesh)
                ok = True
            if remove:
                scene.remove_collision_mesh(name)
                ok = True
        return ok
# ---------- end cm ----------
cm_2 = CollisionMesh(scene=scene, mesh=mesh_8, identifier="base_mesh", add=Button(), remove=Button())  # -> ok; inputs mesh: Mesh, add: Boolean, remove: Boolean; same code as cm
panel_39 = Panel(cm_2)
panel_40 = Panel(cm)

constraints_from_plane = ConstraintsFromPlane(robot=data_10, plane=pln_33, group=data_12)  # -> constraints
#   port plane: The plane or frame from which we create position and orientation constraints.
#   port group: The planning group for which we specify the constraint. Defaults to the robot's main planning group.
#   port tolerance_position: The allowed tolerance to the frame's position (defined in the robot's units). Defaults to 0.001
#   port tolerance_xaxis: The allowed tolerance of the frame's X-axis in degrees.
#   port tolerance_yaxis: The allowed tolerance of the frame's Y-axis in degrees.
#   port tolerance_zaxis: The allowed tolerance of the frame's Z-axis in degrees.
#   port constraints: A list containing a position and an orientation constraint.
# ---------- constraints_from_plane: Python ----------
"""
Create a position and an orientation constraint from a plane calculated for the group's end-effector link.

COMPAS FAB v0.19.1
"""
import math

from ghpythonlib.componentbase import executingcomponent as component

from compas_fab.ghpython.components import coerce_frame


class ConstraintsFromPlane(component):
    def RunScript(self, robot, plane, group, tolerance_position, tolerance_xaxis, tolerance_yaxis, tolerance_zaxis):
        goal_constraints = None
        if robot and plane:
            tolerance_position = tolerance_position or 0.001
            tolerance_xaxis = tolerance_xaxis or 1.
            tolerance_yaxis = tolerance_yaxis or 1.
            tolerance_zaxis = tolerance_zaxis or 1.

            frame = coerce_frame(plane)
            tolerances_axes = [math.radians(tolerance_xaxis), math.radians(tolerance_yaxis), math.radians(tolerance_zaxis)]
            goal_constraints = robot.constraints_from_frame(frame, tolerance_position, tolerances_axes, group)

        return goal_constraints
# ---------- end constraints_from_plane ----------
plan_motion = PlanMotion(robot=data_10, goal_constraints=constraints_from_plane, start_configuration=filter_5, group=data_12, compute=Button())  # -> trajectory; inputs goal_constraints: list, attached_collision_meshes: list of Mesh, path_constraints: list, compute: Boolean
#   port goal_constraints: The goal to be achieved, defined in a set of constraints. Constraints can be very specific, for example defining value domains for each joint, such that the goal configuration is included, or defining a volume in space, to which a specific robot link (e.g. the end-effector) is required to move to.
#   port start_configuration: The robot's full configuration, i.e. values for all configurable joints of the entire robot, at the starting position. Defaults to the all-zero configuration.
#   port group: The planning group used for calculation. Defaults to the robot's main planning group.
#   port attached_collision_meshes: A list of attached collision meshes to be included for planning.
#   port path_constraints: Optional constraints that can be imposed along the solution path. Note that path calculation won't work if the start_configuration violates these constraints. Defaults to None.
#   port planner_id: The name of the algorithm used for path planning. Defaults to 'RRTConnectkConfigDefault'
#   port compute: If True, calculates a trajectory.
#   port trajectory: The calculated trajectory.
# ---------- plan_motion: Python ----------
"""
Calculate a motion path.

COMPAS FAB v0.19.1
"""
from ghpythonlib.componentbase import executingcomponent as component
from scriptcontext import sticky as st

from compas_fab.ghpython.components import create_id


class PlanMotion(component):
    def RunScript(self, robot, goal_constraints, start_configuration, group, attached_collision_meshes, path_constraints, planner_id, compute):

        key = create_id(self, 'trajectory')

        path_constraints = list(path_constraints) if path_constraints else None
        attached_collision_meshes = list(attached_collision_meshes) if attached_collision_meshes else None
        planner_id = str(planner_id) if planner_id else 'RRTConnectkConfigDefault'

        if robot and robot.client and robot.client.is_connected and start_configuration and goal_constraints and compute:
            st[key] = robot.plan_motion(goal_constraints,
                                        start_configuration=start_configuration,
                                        group=group,
                                        options=dict(
                                            attached_collision_meshes=attached_collision_meshes,
                                            path_constraints=path_constraints,
                                            planner_id=planner_id,
                                        ))

        trajectory = st.get(key, None)
        return trajectory
# ---------- end plan_motion ----------
trajectory_visualize = TrajectoryVisualize(robot=data_10, group=data_12, trajectory=plan_motion)  # -> start_configuration, configurations, fraction, time, planes, P, V, A
#   port group: The planning group for which this trajectory was planned.
#   port trajectory: The calculated trajectory.
#   port start_configuration: The start configuration of the trajectory.
#   port configurations: The full configurations along the trajectory.
#   port fraction: Indicates the fraction of requested trajectory that was calculated, e.g. 1 means the full trajectory was found.
#   port time: The time which is needed to execute that trajectory at full speed.
#   port planes: The planes of the robot's end-effector.
#   port P: The positions along the trajectory
#   port V: The velocities along the trajectory
#   port A: The accelerations along the trajectory
# ---------- trajectory_visualize: Python ----------
"""
Visualizes a trajectory.

COMPAS FAB v0.19.1
"""
from compas_ghpython import draw_frame
from compas_ghpython import list_to_ghtree
from ghpythonlib.componentbase import executingcomponent as component


class TrajectoryVisualize(component):
    def RunScript(self, robot, group, trajectory):
        start_configuration = None
        configurations = []
        fraction = 0.
        time = 0.

        planes = []
        positions = []
        velocities = []
        accelerations = []

        if robot and trajectory:
            group = group or robot.main_group_name

            for c in trajectory.points:
                configurations.append(robot.merge_group_with_full_configuration(c, trajectory.start_configuration, group))
                frame = robot.forward_kinematics(c, group, options=dict(solver='model'))
                planes.append(draw_frame(frame))
                positions.append(c.positions)
                velocities.append(c.velocities)
                accelerations.append(c.accelerations)

            start_configuration = trajectory.start_configuration
            fraction = trajectory.fraction
            time = trajectory.time_from_start

        P = list_to_ghtree(list(zip(*positions)))
        V = list_to_ghtree(list(zip(*velocities)))
        A = list_to_ghtree(list(zip(*accelerations)))

        # return outputs if you have them; here I try it for you:
        return (start_configuration, configurations, fraction, time, planes, P, V, A)
# ---------- end trajectory_visualize ----------
item_11 = ListItem(List=trajectory_visualize.configurations, Index=Slider(15, range=0..50), Wrap=False)
robot_visualize_2 = RobotVisualize(robot=data_10, configuration=item_11)  # -> visual, collision, attached_meshes, frames, base_frame, ee_frame; inputs attached_collision_meshes: list, show_visual: Boolean, show_collision: Boolean, show_frames: Boolean, show_base_frame: Boolean, show_end_effector_frame: Boolean, show_acm: Boolean; same code as robot_visualize

python_25 = GhPythonScript(configs=trajectory_visualize.configurations, path=panel_29, member_num=panel_30, save_data=Button())  # inputs configs: list
# ---------- python_25: Python ----------
import os
from compas_fab.utilities import write_data_to_json

configs_combined = {}
if save_data:
    for i,c in enumerate(configs):
        configs_combined['config_{}'.format(i)] = c.to_data()
        #c.to_json(os.path.join(path, 'member_{}/config_{}.json'.format(member_num,i)))

    #print configs_combined
    write_data_to_json(configs_combined, os.path.join(path, 'member_{}.json'.format(member_num)))
# ---------- end python_25 ----------
