# Grasshopper definition ACADIA_network.gh (Grasshopper 1.0.7)
# plug-ins: Human

# INPUT GEOMETRY
crv = Curve([<curve referenced from the Rhino model> x45])

# ---- group: members
number_slider = Slider(44, range=0..44)
python = GhPythonScript(n=number_slider)  # -> rob_num; inputs n: Int32
# ---------- python: Python ----------
#Robot Order

order = [
2, #0
1, #1
2, #2
1, #3
2, #4
1, #5
2, #6
1, #7
2, #8
2, #9
1, #10
2, #11
2, #12
1, #13
2, #14
2, #15
1, #16
1, #17
2, #18
1, #19
2, #20
1, #21
2, #22
2, #23
2, #24
1, #25
2, #26
1, #27
2, #29
2, #28
1, #30
2, #31
1, #32
1, #33
1, #34
2, #33
2, #38
1, #36
1, #37
#done
2, #36
2, #37
2, #39
2, #41
2, #42
1, #43
]

rob_num = order[n]
# ---------- end python ----------
python_2 = GhPythonScript(n=number_slider)  # -> idx; inputs n: Int32
# ---------- python_2: Python ----------
idx = range(n+1)

print idx
# ---------- end python_2 ----------
panel = Panel(number_slider)
panel_2 = Panel(python)
data = Data(crv)
data_2 = Data(python_2)

# ---- group: nodes
pt = Point([<point referenced from the Rhino model> x17])
python_3 = GhPythonScript(n=number_slider)  # -> idx; inputs n: Int32
# ---------- python_3: Python ----------
sphere_order = {
0: 2,
1: 3,
2: 4,
3: 4,
4: 4,
5: 4,
6: 5,
7: 5,
8: 5,
9: 6,
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}

idx = range(sphere_order[n])

print idx
# ---------- end python_3 ----------
data_3 = Data(pt)
data_4 = Data(python_3)

# ---- group: cross-section
# 1 3/16" (30.16mm) section.
# this dist is to corner
panel_3 = Panel("0.0333375")
division = Division(A=panel_3, B="sqrt(2)")
polygon = Polygon(Plane=PlaneXY(0, 0, 0), Radius=division, Segments="4", FilletRadius=0)  # -> Polygon, Length
rotate = Rotate(Geometry=polygon.Polygon, Angle=degrees("45"), Plane=PlaneXY(0, 0, 0))  # -> Geometry, Transform
crv_2 = Curve(rotate.Geometry)

# ---- group: current member curves
data_5 = Data(data_2)
data_6 = Data(data)
item = ListItem(List=data_6, Index=data_5, Wrap=True)
crv_3 = Curve(item)

# ---- group: nodes
data_7 = Data(data_3)
data_8 = Data(data_4)
item_2 = ListItem(List=data_7, Index=data_8, Wrap=True)
sph = Sphere(Base=item_2, Radius="0.0333375")

# ----
pt_2 = Point(item_2)
crv_4 = Curve(crv_3)
number_slider_2 = Slider(24, range=0..45)
python_4 = GhPythonScript(reset=Toggle(True), nodes=pt_2)  # -> out, network, gkey_node; inputs nodes: list of Point3d
# ---------- python_4: Python ----------
from copy import deepcopy

from compas_rhino.geometry import RhinoPoint

from compas.utilities import geometric_key
from compas.geometry import KDTree

from compas.datastructures import Network

if reset:
    network = Network()

# print values
print("=== Network created ===")
print("number of edges: {}".format(network.number_of_edges()))
print("number of nodes: {}".format(network.number_of_nodes()))


for i,node in enumerate(nodes):
    p = RhinoPoint.from_geometry(node).to_compas()
    x, y, z = p
    # can add another attribute e.g. type="is_anchor"
    network.add_node(x=x, y=y, z=z)
    
    
network2 = deepcopy(network)
node_xyz = {node: network2.node_coordinates(node) for node in network2.nodes()}
#gkey_node = {geometric_key(xyz): node for node, xyz in node_xyz.items()}
gkey_node = network2.gkey_node()
search_tree = KDTree(node_xyz.values())

gkey_node = [gkey_node]

print network
# ---------- end python_4 ----------
python_5 = GhPythonScript(network=python_4.network, n=number_slider_2, edges=crv_4, gkey_node=python_4.gkey_node)  # -> out, network; inputs edges: list of Line, gkey_node: list
# ---------- python_5: Python ----------
from compas.datastructures import Network
from compas_rhino.geometry import RhinoLine


gkey_node = gkey_node[0]

def gen_gkey(pnt):
    return "{:.3f},{:.3f},{:.3f}".format(round(pnt.x,3), round(pnt.y,3), round(pnt.z,3))

for i,edge in enumerate(edges):
    e = RhinoLine.from_geometry(edge).to_compas()
    u = gkey_node[gen_gkey(e.start)]
    v = gkey_node[gen_gkey(e.end)]
    network.add_edge(u,v,type="member", number = "{}".format(i))
    
    #just to see a random edge
    if i == n:
        network.add_edge(u,v,type="support_option",number = "{}".format(i))

    #just to see a random edge
    if i == n+1:
        network.add_edge(u,v,type="remove_option",number = "{}".format(i))

for edge in network.edges():
    edge_number = network.edge_attribute(key=edge, name="number")
    print edge_number, edge
    
print network
# ---------- end python_5 ----------
# connect this network element
python_6 = GhPythonScript(network=python_5.network)  # -> out, max_members, min_members, network
# ---------- python_6: Python ----------
import operator
import collections

### FUNCTIONS ####
##################

#dictionary, node: # of connecting members
def make_adj_cnt():
    dict = {}
    for n in range(network.number_of_nodes()): 
        dict[n] = len(network.data['data']['adjacency']['{}'.format(n)])
    return dict

#dictionary, sum of connectivity of the two nodes defining each member
def make_adj_cnt_member(adj_cnt):
    dict = {}
    for i,edge in enumerate(network.edges()):
        u,v = edge
        dict[i] = adj_cnt[u] + adj_cnt[v]
    return dict

#get a list of members with max connectivity
def get_members_with_max(memb_list):
    max_cnt = memb_list[0][1]
    max_list = []
    
    for memb in memb_list:
        print memb
        if memb[1] >= max_cnt:
            max_list.append(memb[0])
        else: #can break because in max order
            break
        
    return max_list
    
#get a list of members with min connectivity
def get_members_with_min(memb_list):
    min_cnt = memb_list[-1][1] + 1
    min_list = []
    
    for memb in memb_list:
        if memb[1] <= min_cnt:
            min_list.append(memb[0])
        
    return min_list

#______________________________#
#______________________________#

adj_cnt = make_adj_cnt()
adj_cnt_member = make_adj_cnt_member(adj_cnt)

sorted_adj_cnt_member = sorted(adj_cnt_member.items(), key=operator.itemgetter(1))
sorted_adj_cnt_member.reverse()

print sorted_adj_cnt_member

#members with max supports
max_members = get_members_with_max(sorted_adj_cnt_member)
min_members = get_members_with_min(sorted_adj_cnt_member)

print max_members, min_members

for edge in network.edges():
    edge_number = network.edge_attribute(key=edge, name="number")
    print edge
    
    if int(edge_number) in max_members:
        network.edge_attribute(key=edge, name="type", value = "support_option")

    if int(edge_number) in min_members:
        network.edge_attribute(key=edge, name="type", value = "remove_option")

print network
# ---------- end python_6 ----------
python_7 = GhPythonScript(network=python_5.network, start_member=number_slider_2)  # -> out, network; inputs start_member: Int32
# ---------- python_7: Python ----------
import copy

for edge in network.edges():
    network.edge_attribute(key=edge, name="cell", value = "0")

#find the edges connected to the nodes defining given edge
for u,v in network.edges_where({"number":"{}".format(start_member)}):
    nodes1 = network.connected_edges(u)
    nodes2 = network.connected_edges(v)

#flatten the node list defining connecting elements
nodes1 = (sum(nodes1, ()))
nodes2 = (sum(nodes2, ()))

#remove two starting nodes from the lists
nodes1 = [i for i in nodes1 if i not in [u,v]]
nodes2 = [i for i in nodes2 if i not in [u,v]]
print nodes1,nodes2

#find the nodes that are similar across both sets (edges connect)
nodes1_as_set = set(nodes1)
adj_nodes = list(nodes1_as_set.intersection(nodes2))
print adj_nodes

#out of the 3 adjacent nodes, find the one that connects the other two
# this node, along with u,v are shared across both cells
apex_node = []
for i in adj_nodes:
    count = 0
    for j in adj_nodes:
        if network.has_edge(i,j, False):
            count += 1
            
        if count == 2:
            apex_node = i
            break

#each rigid cell is defined by 4 nodes
# the remaining two nodes, one to to each
adj_nodes.remove(apex_node)
print "apex node: ", apex_node
print "remaining: ", adj_nodes

cell_1_nodes = [u,v,apex_node,adj_nodes.pop()]
cell_2_nodes = [u,v,apex_node,adj_nodes.pop()]
print cell_1_nodes, cell_2_nodes

#create a new attribute for the 6 elements that define a cell
while cell_1_nodes:
    a = cell_1_nodes.pop()
    
    for i in cell_1_nodes:
        if network.has_edge(a,i):
            network.edge_attribute(key = (a, i), name = "cell", value = "1")
        else:
            network.edge_attribute(key = (i, a), name = "cell", value = "1")

while cell_2_nodes:
    a = cell_2_nodes.pop()
    
    for i in cell_2_nodes:
        if network.has_edge(a,i):
            network.edge_attribute(key = (a, i), name = "cell", value = "2")
        else:
            network.edge_attribute(key = (i, a), name = "cell", value = "2")


print network
# ---------- end python_7 ----------
python_8 = GhPythonScript(network=python_7.network)  # -> out, draw_nodes, cell_1, cell_2; inputs node_list: list of Int32
# ---------- python_8: Python ----------
from compas_ghpython.artists import NetworkArtist

cell_1 = []
cell_2 = []
for edge in network.edges():
    edge_type = network.edge_attribute(key=edge, name="cell")
    print edge_type
    if edge_type == "1":
        cell_1.append(edge)
    elif edge_type == "2":
        cell_2.append(edge)

artist = NetworkArtist(network)
cell_1 = artist.draw_edges(cell_1)
cell_2 = artist.draw_edges(cell_2)
draw_nodes = artist.draw_nodes(node_list)
# ---------- end python_8 ----------
panel_4 = Panel(python_6.max_members)
python_9 = GhPythonScript(network=python_5.network)  # -> out, m_typ, m_sup, m_rem
# ---------- python_9: Python ----------
from compas_ghpython.artists import NetworkArtist

member_typ = []
member_support = []
member_remove = []

for edge in network.edges():
    edge_type = network.edge_attribute(key=edge, name="type")
    if edge_type == "member":
        member_typ.append(edge)
    elif edge_type == "support_option":
        member_support.append(edge)
    elif edge_type == "remove_option":
        member_remove.append(edge)


#xyz = network.node_attributes(13, "xyz")
#print(xyz)

artist = NetworkArtist(network)
m_typ = artist.draw_edges(member_typ)
m_sup = artist.draw_edges(member_support)
m_rem = artist.draw_edges(member_remove)
# ---------- end python_9 ----------

panel_5 = Panel("shows rigid cells")
pt_3 = Point(python_8.draw_nodes)
crv_5 = Curve(python_8.cell_1)
crv_6 = Curve(python_8.cell_2)
entwine = Entwine(Branch00=crv_5, Branch01=crv_6, FlattenInputs=True)
entwine_2 = Entwine(
    Branch00=ColourSwatch(SwatchColor=RGB(255, 0, 0)),
    Branch01=ColourSwatch(SwatchColor=RGB(21, 255, 0)),
    FlattenInputs=True)
entwine_3 = Entwine(Branch00="10", Branch01="10", FlattenInputs=True)
previewlw = CustomPreviewLineweights(Geometry=entwine, Shader=entwine_2, Thickness=entwine_3, Absolute=False)

# ----
# shows members with max/min
swatch = ColourSwatch(SwatchColor=RGB(0, 0, 0))
crv_7 = Curve(python_9.m_typ)
crv_8 = Curve(python_9.m_sup)
crv_9 = Curve(python_9.m_rem)
entwine_4 = Entwine(Branch00=crv_7, Branch01=crv_8, Branch02=crv_9, FlattenInputs=True)
entwine_5 = Entwine(
    Branch00=swatch,
    Branch01=ColourSwatch(SwatchColor=RGB(202, 87, 255)),
    Branch02=ColourSwatch(SwatchColor=RGB(0, 0, 0)),
    FlattenInputs=True)
entwine_6 = Entwine(Branch00="5", Branch01="5", Branch02="5", FlattenInputs=True)
previewlw_2 = CustomPreviewLineweights(Geometry=entwine_4, Shader=entwine_5, Thickness=entwine_6, Absolute=False)
